# Dynamo graph ExportToExcel.dyn (Dynamo 2.17.0.3472)

# group: Get Data
all_elements_in_active_view = ElementsInView()
getCategory = Element.GetCategory(element=all_elements_in_active_view)
elementType = Element.ElementType(element=all_elements_in_active_view)
id = Element.Id(element=all_elements_in_active_view)
code_block = CodeBlock { "Level"; }
parameterByName = Parameter.ParameterByName(element=all_elements_in_active_view, name=code_block)

# group: Format Data
list_create = List.Create(item0=getCategory, item1=elementType, item2=id, item3=parameterByName)
transpose = List.Transpose(lists=list_create)

# group: Export to Excel
file_path = Filename("C:\Users\User\Desktop\ExportRevit.xlsx")
code_block_2 = CodeBlock { "Sheet1"; 0; true; }
exportToExcel = Data.ExportToExcel(filePath=file_path, sheetName=code_block_2.out0, startRow=code_block_2.out1, startColumn=code_block_2.out1, data=transpose, overWrite=code_block_2.out2)
